# Grasshopper definition GHdemo.gh (Grasshopper 1.0.7)

number_slider = Slider(47, range=0..50)
cir = Circle(Plane=PlaneXY(0, 0, 0), Radius=Slider(481, range=0..1000))
divide = DivideCurve(Curve=cir, Count=number_slider, Kinks=False)  # -> Points, Tangents, Parameters
division = Division(A=number_slider, B=Slider(3, range=0..10))
pt = PointOriented(BasePlane=divide.Points, UComponent=0, VComponent=0, WComponent=Slider(780, range=0..1000))
entwine = Entwine(Branch00=divide.Points, Branch01=pt, FlattenInputs=True)
shift = ShiftList(List=pt, Shift=division, Wrap=True)
pline = PolyLine(Vertices=entwine, Closed=invert(False))
ln = Line(StartPoint=divide.Points, EndPoint=shift)
